# Grasshopper definition assignment-01.gh (Grasshopper 1.0.8)

# Assignment-01: Bauhaus
number_slider = Slider(5, range=0..5)
py3 = Python3Script(
    tower_count=number_slider,
    spacing_mult=Slider(1.184, range=0..5),
    bridge_z=Slider(47.171, range=0..50),
    cantilever_len=Slider(5, range=0..5),
    cylinder_radius=Slider(8.498, range=0..30),
    cylinder_z_center=Slider(1, range=0..10))  # -> out, towers, bridge, arch_void, info
# ---------- py3: Python ----------
"""
Inputs  (Item Access, float unless noted):
    tower_count (int), spacing_mult, bridge_z, cantilever_len,
    cylinder_radius, cylinder_z_center
Outputs:
    towers, bridge, arch_void, out

Wiring:
    towers + bridge -> Solid Union (flatten the input) -> Solid Difference A
    arch_void                                          -> Solid Difference B

Presets (tower_count, spacing_mult, bridge_z, cantilever_len, cylinder_radius, cylinder_z_center):
    A baseline     : 3, 2.5, 100, 20, 10, 0
    B twin gate    : 4, 1.2,  80, 10, 30, 0
    C wide horizon : 5, 1.8, 140, 60, 12, 0
"""

import importlib
import cdf.geometry_basics as gb
importlib.reload(gb)

result = gb.build_composition(
    tower_count, spacing_mult, bridge_z,
    cantilever_len, cylinder_radius, cylinder_z_center,
)

towers = result["towers"]
bridge = result["bridge"]
arch_void = result["arch_void"]

info = result["info"]
out = "\n".join([
    "towers: {}".format(len(info["heights"])),
    "pitch: {:.2f}".format(info["pitch"]),
    "k: {:.3f}".format(info["k"]),
    "heights: " + ", ".join("{:.1f}".format(h) for h in info["heights"]),
    "bridge X: {:.1f} .. {:.1f}".format(info["bridge_x0"], info["bridge_x1"]),
    "pierce: {:.1f} above bridge top {:.1f}".format(info["pierce_amount"], info["bridge_top"]),
])
# ---------- end py3 ----------
sunion = SolidUnion(Breps=flatten([py3.towers, py3.bridge]))
sdiff = SolidDifference(BrepsA=sunion, BrepsB=py3.arch_void)
preview = CustomPreview(Geometry=sdiff, Material=ColourSwatch(SwatchColor=RGB(166, 85, 85)))
